# Grasshopper definition IOMesh.gh (Grasshopper 1.0.7)

saved_territory_folder = Panel("E:\Downloads\Godbert\f1t1")

# ---- group: Load
path = FilePath(saved_territory_folder)
c_script = CSharpScript(directory=path)  # -> filePaths; inputs directory: String
# ---------- c_script: C# usings ----------
using System.IO;
# ---------- c_script: C# ----------
    filePaths = Directory.GetFiles(directory, "*.obj");
# ---------- end c_script ----------
c_script_2 = CSharpScript(directory=path)  # -> savedPath; inputs directory: String
# ---------- c_script_2: C# ----------
    var dir = Path.GetDirectoryName(Grasshopper.Instances.ActiveCanvas.Document.FilePath);
    var name = new DirectoryInfo(directory).Name;
    savedPath = Path.Combine(dir, name + ".json");
# ---------- end c_script_2 ----------
importobj = CSharpScript(filePath=c_script)  # inputs filePath: String
# ---------- importobj: C# usings ----------
using Rhino.FileIO;
using Rhino.DocObjects;
using System.IO;
# ---------- importobj: C# ----------
    var fileName = Path.GetFileNameWithoutExtension(filePath);

    var doc = Rhino.RhinoDoc.ActiveDoc;
    var layers = doc.Layers;

    var parentLayer = layers.FindName("Meshes");
    if (parentLayer == null)
    {
      parentLayer = layers[layers.Add(new Layer()
        {
          Name = "Meshes",
          })];
    }
    parentLayer.IsLocked = true;

    if (layers.FindName(fileName) != null) return;

    layers.SetCurrentLayerIndex(layers.Add(new Layer()
      {
        Name = fileName,
        ParentLayerId = parentLayer.Id,
        }), true);

    var readOptions = new FileReadOptions();
    readOptions.BatchMode = false;

    var option = new FileObjReadOptions(readOptions);
    option.MapYtoZ = true;

    FileObj.Read(filePath, doc, option);
# ---------- end importobj ----------
import_saved_graph = CSharpScript(
    savedPath=c_script_2,
    Reference=["E:\OneDrive - stu.zafu.edu.cn\PartTime\FFXIV\TakeMeEverywhere\TerritoryMesh\Newtonsoft.Json.dll", "C:\Program Files (x86)\Reference Assemblies\Microsoft\Framework\.NETFramework\v4.8\System.Numerics.dll"])  # -> trigger; inputs savedPath: String
# ---------- import_saved_graph: C# usings ----------
using System.Numerics;
using System.Drawing;
using System.IO;
using System.Linq;
using Rhino.DocObjects;
using Rhino.DocObjects.Tables;
using Rhino.FileIO;
using Newtonsoft.Json;
# ---------- import_saved_graph: C# ----------
    var layers = Rhino.RhinoDoc.ActiveDoc.Layers;
    var runIndex = AddLayer(layers, "Run", Color.DarkGreen);
    var flyIndex = AddLayer(layers, "Fly", Color.DarkBlue);

    var obj = JsonConvert.DeserializeObject<TerritoryGraph>(File.ReadAllText(savedPath));

    LoadGraph(obj, runIndex, flyIndex);
# ---------- import_saved_graph: C# additional code ----------
  private static int AddLayer(LayerTable layers, string name, Color color)
  {
    var layer = layers.FindName(name);
    if (layer != null) return layer.Index;

    return layers.Add(new Layer()
      {
        Name = name,
        Color = color,
        });
  }

  private static void LoadGraph(TerritoryGraph graph, int runLayer, int flyLayer)
  {
    var option = new FileObjReadOptions(new FileReadOptions());
    option.MapYtoZ = true;

    var trans = option.GetTransform();

    LoadGraph(graph.Run, runLayer, trans);
    LoadGraph(graph.Fly, flyLayer, trans);
  }

  private static void LoadGraph(GraphDto graph, int layer, Transform trans)
  {
    if (Rhino.RhinoDoc.ActiveDoc.Objects.Any(o => o.Attributes.LayerIndex == layer)) return;

    for (int i = 0; i < graph.Edges.Length / 2; i++)
    {
      var edge = graph.Edges[i];

      var start = graph.Nodes[edge.Start];
      var end = graph.Nodes[edge.End];

      var startPt = new Point3d(start.X, start.Y, start.Z);
      var endPt = new Point3d(end.X, end.Y, end.Z);

      startPt.Transform(trans);
      endPt.Transform(trans);

      Rhino.RhinoDoc.ActiveDoc.Objects.Add(new LineCurve(startPt, endPt), new Rhino.DocObjects.ObjectAttributes()
        {
          LayerIndex = layer,
          });
    }
  }

  public struct GraphDto
  {
    public Vector3[] Nodes { get; set; }

    public EdgeDto[] Edges { get; set; }
  }
  public struct EdgeDto
  {
    public int Start { get; set; }
    public int End { get; set; }
    public float Velocity { get; set; }
  }
  public struct TerritoryGraph
  {
    public GraphDto Run { get; set; }
    public GraphDto Fly { get; set; }
  }
# ---------- end import_saved_graph ----------

# ----
panel = Panel(c_script_2)

# ---- group: Save
c_script_3 = CSharpScript(
    trigger=import_saved_graph,
    Reference="C:\Program Files (x86)\Reference Assemblies\Microsoft\Framework\.NETFramework\v4.8\System.Numerics.dll")  # -> graph
# ---------- c_script_3: C# usings ----------
using System.Linq;
using System.Numerics;
using Rhino.FileIO;
# ---------- c_script_3: C# ----------
    graph = new TerritoryGraph()
      {
        Run = CreateGraph(FindLinesByLayer("Run")),
        Fly = CreateGraph(FindLinesByLayer("Fly")),
        };
# ---------- c_script_3: C# additional code ----------
  private static double tol = 0.01;
  private static GraphDto CreateGraph(Line[] lines)
  {
    if(lines.Length == 0)
    {
      return new GraphDto()
        {
          Edges = Array.Empty<EdgeDto>(),
          Nodes = Array.Empty<Vector3>(),
          };
    }
    var option = new FileObjReadOptions(new FileReadOptions());
    option.MapYtoZ = true;

    Transform trans;
    option.GetTransform().TryGetInverse(out trans);

    var pts = Point3d.CullDuplicates(lines.Select(l => l.From).Concat(lines.Select(l => l.To)), tol);

    var edges = lines.Select(l => new EdgeDto()
      {
        Start = GetIndex(pts, l.From),
        End = GetIndex(pts, l.To),
        Velocity = 1,
        }).ToArray();

    edges = edges.Concat(edges.Select(e => new EdgeDto()
      {
        Start = e.End,
        End = e.Start,
        Velocity = e.Velocity,
        })).ToArray();

    var nodes = pts.Select(p =>
      {
      p.Transform(trans);
      return new Vector3((float) p.X, (float) p.Y, (float) p.Z);
      }).ToArray();

    return new GraphDto()
      {
        Edges = edges,
        Nodes = nodes,
        };
  }
  private static Line[] FindLinesByLayer(string layerName)
  {
    var objs = Rhino.RhinoDoc.ActiveDoc.Objects.FindByLayer(layerName)
      .Select(o => o.Geometry);

    return objs.OfType<LineCurve>().Select(l => l.Line)
      .Concat(objs.OfType<PolylineCurve>()
      .SelectMany(p => p.ToPolyline().GetSegments())).ToArray();
  }

  private static int GetIndex(Point3d[] pts, Point3d p)
  {
    double minDis = double.MaxValue;
    int index = -1;
    for (int i = 0; i < pts.Length; i++)
    {
      var dis = p.DistanceToSquared(pts[i]);
      if(dis < minDis)
      {
        minDis = dis;
        index = i;
      }
    }
    return index;
  }

  public struct GraphDto
  {
    public Vector3[] Nodes { get; set; }

    public EdgeDto[] Edges { get; set; }
  }
  public struct EdgeDto
  {
    public int Start { get; set; }
    public int End { get; set; }
    public float Velocity { get; set; }

    public override string ToString()
    {
      return string.Format("Start {0}, End {1}", Start, End);
    }
  }
  public struct TerritoryGraph
  {
    public GraphDto Run { get; set; }
    public GraphDto Fly { get; set; }
  }
# ---------- end c_script_3 ----------
c_script_4 = CSharpScript(
    savedPath=c_script_2,
    obj=c_script_3,
    Reference="E:\OneDrive - stu.zafu.edu.cn\PartTime\FFXIV\TakeMeEverywhere\TerritoryMesh\Newtonsoft.Json.dll")  # -> A; inputs savedPath: String
# ---------- c_script_4: C# usings ----------
using Newtonsoft.Json;
using System.IO;
# ---------- c_script_4: C# ----------
    var str = JsonConvert.SerializeObject(obj, Formatting.Indented);
    File.WriteAllText(savedPath, str);
# ---------- end c_script_4 ----------

# ---- group: Viewer
python = GhPythonScript(x=c_script_3)  # -> run, fly
# ---------- python: Python ----------
run = x.Run
fly = x.Fly
# ---------- end python ----------
python_2 = GhPythonScript(x=python.run)  # -> a, b
# ---------- python_2: Python ----------
a = x.Nodes
b = x.Edges
# ---------- end python_2 ----------
python_3 = GhPythonScript(x=python.fly)  # -> a, b; same code as python_2
nodes = Panel(python_2.a)
edges = Panel(python_2.b)
nodes_2 = Panel(python_3.a)
edges_2 = Panel(python_3.b)
python_4 = GhPythonScript(edges=python_3.b)  # -> result; inputs edges: list
# ---------- python_4: Python ----------
result = []

for edge in edges:
    start = edge.Start
    end = edge.End
    
    startIndex = -1
    endIndex = -1
    
    for i in range(len(result)):
        
        if start in result[i]:
            startIndex = i
        if end in result[i]:
            endIndex = i
    
    if startIndex != -1 and endIndex != -1:
        
        if startIndex != endIndex:
            lowerIndex = min(startIndex, endIndex)
            upperIndex = max(startIndex, endIndex)
            
            result[lowerIndex] += result[upperIndex]
            
            del result[upperIndex]
        
    elif startIndex != -1:
        result[startIndex].append(end)
    
    elif endIndex != -1:
        result[endIndex].append(start)
    
    else:
        result.append([start, end])

import ghpythonlib.treehelpers as ght

result = len(result)
# ---------- end python_4 ----------
python_5 = GhPythonScript(edges=python_2.b)  # -> result; inputs edges: list; same code as python_4
panel_2 = Panel(python_4)
panel_3 = Panel(python_5)
