# Grasshopper definition importMesh.gh (Grasshopper 1.0.7)

path = FilePath("D:\Downloads\Godbert\s1t2\")
c_script = CSharpScript(directory="E:\Downloads\Godbert\f1t1")  # -> filePaths; inputs directory: String
# ---------- c_script: C# usings ----------
using System.IO;
using System.Drawing;
using Rhino.DocObjects;
using Rhino.DocObjects.Tables;
# ---------- c_script: C# ----------
    filePaths = Directory.GetFiles(directory, "*.obj");

    var layers = Rhino.RhinoDoc.ActiveDoc.Layers;
    AddLayer(layers, "Run", Color.DarkGreen);
    AddLayer(layers, "Fly", Color.DarkBlue);
# ---------- c_script: C# additional code ----------
  private static void AddLayer(LayerTable layers, string name, Color color)
  {
    if (layers.FindName(name) != null) return;

    layers.Add(new Layer()
      {
        Name = name,
        Color = color,
        });
  }
# ---------- end c_script ----------
c_script_2 = CSharpScript(layerName="Run")  # -> lines; inputs layerName: String
# ---------- c_script_2: C# usings ----------
using System.Linq;
# ---------- c_script_2: C# ----------
    var layer = Rhino.RhinoDoc.ActiveDoc.Layers.FindName(layerName);
    lines = Rhino.RhinoDoc.ActiveDoc.Objects.FindByLayer(layer)
      .Select(o => o.Geometry)
      .OfType<PolylineCurve>()
      .SelectMany(p => p.ToPolyline().GetSegments());
# ---------- end c_script_2 ----------
c_importobj = CSharpScript(filePath=c_script)  # inputs filePath: String
# ---------- c_importobj: C# usings ----------
using Rhino.FileIO;
using Rhino.DocObjects;
using System.IO;
# ---------- c_importobj: C# ----------
    var fileName = Path.GetFileNameWithoutExtension(filePath);

    var doc = Rhino.RhinoDoc.ActiveDoc;
    var layers = doc.Layers;

    var parentLayer = layers.FindName("Meshes");
    if (parentLayer == null)
    {
      parentLayer = layers[layers.Add(new Layer()
        {
          Name = "Meshes",
          })];
    }
    parentLayer.IsLocked = true;

    if (layers.FindName(fileName) != null) return;

    layers.SetCurrentLayerIndex(layers.Add(new Layer()
      {
        Name = fileName,
        ParentLayerId = parentLayer.Id,
        }), true);

    var readOptions = new FileReadOptions();
    readOptions.BatchMode = false;

    var option = new FileObjReadOptions(readOptions);
    option.MapYtoZ = true;

    FileObj.Read(filePath, doc, option);
# ---------- end c_importobj ----------
